% Simulink data dictionary escontrol.sldd

ESC_DT1_offset_sinwave_modulation = 0
ESC_DT1_offset_sinwave_demodulation = 0
ESC_DT2_offset_sinwave_modulation = 0
ESC_DT2_offset_sinwave_demodulation = 0

t_parameters = Simulink.Bus()  % input parameter type
  w: double
  w_2: double
  a: double
  a_2: double
  phi1: double
  phi1_2: double
  enable_hpf: double
  enable_hpf_2: double
  w_hpf: double
  w_hpf_2: double
  k: double
  k_2: double
  enable_lpf: double
  enable_lpf_2: double
  w_lpf: double
  w_lpf_2: double
  theta0: double
  theta0_2: double
  b: double
  b_2: double
  phi2: double
  phi2_2: double
  theta_max: double
  theta_max_2: double
  theta_min: double
  theta_min_2: double

Ts_escontrol = 0.02
Configuration_template = Simulink.ConfigSet(StartTime="0", StopTime="10", FixedStep="Ts_escontrol", Solver="FixedStepAuto", ProdHWDeviceType="Intel->x86-64 (Windows64)", SystemTargetFile="ert.tlc", TargetLang="C")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
Configuration_notused = Simulink.ConfigSet(StartTime="0", StopTime="10", RelTol="1e-3", Solver="VariableStepAuto", ProdHWDeviceType="Intel->x86-64 (Windows64)", SystemTargetFile="grt.tlc", TargetLang="C")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