# Requirement set escontrol (R2024a)

## 1 [#4] Parameters
Parameters shall be user-defined.

## 2 [#1] Output bounding
The ES controller output shall be bounded.
Rationale: Ensures plant actuator input levels are not violated.

### 2.1 [#2] Upper bounding
The ES controller output shall be upper bounded.

### 2.2 [#3] Lower bounding
The ES controller output shall be lower bounded.

## 3 [#5] Carrier signal
The carrier signal for modulation and demodulation shall be sinusoidal.

## 4 [#7] Parameter mapping
Instances if the controller shall be mapped to a dedicated parameter set.